% Simulink data dictionary rover_param.sldd

throttle_decay_mode = enum(DefaultValue="NORMAL")
  NORMAL = 0
  EMERGENCY = 1
  COMM_LOSS = 2

TRUE = Simulink.Parameter(1, DataType="boolean")
FALSE = Simulink.Parameter(0, DataType="boolean")

collision_flt = enum(DefaultValue="NONE")
  NONE = 0
  MILD = 1
  SEVERE = 2

OFF = Simulink.Parameter(0, DataType="boolean")
ON = Simulink.Parameter(1, DataType="boolean")